# Grasshopper definition sort_parameters.gh (Grasshopper 1.0.7)
# plug-ins: RoslynScript

csx = GhxCSharpScript(
    O2="2",
    O3="3",
    O4="4",
    O1="1",
    source="E:\Application\Graphics\3d\Modeleur\Rhino\Développement\Rex\Ghx.CSharpScript\test\input_output\sort_parameters.csx",
    m_inconnector_o1=csx,
    m_inconnector_o2=csx,
    m_inconnector_o3=csx,
    m_inconnector_o4=csx)
